# Grasshopper definition ag_demo.gh (Grasshopper 1.0.7)

ratio = Slider(0.5, range=0..1)
python = GhPythonScript(n=Slider(1, range=1..30), levels=Slider(2, range=1..32), ratio=ratio)  # -> circles, centers, radii
# ---------- python: Python ----------
from ghpythonlib.componentbase import executingcomponent as component
import Grasshopper as gh
import GhPython
import System
import Rhino
import rhinoscriptsyntax as rs
import Rhino.Geometry as rg
import cmath

__author__ = "Xuanyu Wu"
__authorID__ = 48236608
__version__ = "2023.11.15"

# functions for rhino geometry
def newPoint(x, y):
    return rg.Point3d(x, y, 0)

def newCircle(r, center=None):
    if not center:
        center = newPoint(0, r)
    return rg.Circle(center, r)

def manyCircles(centers, rs):
    cs = []
    for r, c in zip(rs, centers):
        cs.append(newCircle(r, center=c))
    return cs

# draw apollonian gasket
class Tesslelation(component):
    def __init__(self):
        self.cs = []
        self.rs = []
        self.ks = []

    def apollonianCircle(self, ic1, ic2, ic3, inside=-1):
        '''ic1, ic2, ic3 are indexes for circles, return the apollonius circle'''
        k1, k2, k3 = self.ks[ic1] * inside, self.ks[ic2], self.ks[ic3]
        c1, c2, c3 = self.cs[ic1], self.cs[ic2], self.cs[ic3]
        k4 = k1 + k2 + k3 + 2 * cmath.sqrt(k1 * k2 + k2 * k3 + k1 * k3)

        kc1, kc2, kc3 = c1 * k1, c2 * k2, c3 * k3
        kc4 = kc1 + kc2 + kc3 + 2 * cmath.sqrt(kc1 * kc2 + kc2 * kc3 + kc1 * kc3)
        c4 = kc4 / k4
        self.cs.append(c4)
        self.ks.append(k4)
        self.rs.append(1/k4)

    def RunScript(self, n, levels, ratio):
        # initialize
        n =int(n)
        levels = int(levels)
        R = 128
        
        # first circle (boundary)
        radii_init = [R]    
        center_init = [[0,0]]
        self.cs = [complex(*c) for c in center_init]
        self.rs = [complex(r) for r in radii_init]
        self.ks = [1/r for r in self.rs]
        
        r = R
        last_idx, idx = 0, 1
        for l in range(1, levels):
            self.rs.append(complex(r*ratio))
            self.ks.append(1/self.rs[-1])
            self.rs.append(complex(r*(1-ratio)))
            self.ks.append(1/self.rs[-1])
            self.cs.append(complex(0, r * ratio - R))
            self.cs.append(complex(0, r * ratio - R + r))
            r *= ratio

            for i in range(n):
                self.apollonianCircle(last_idx, idx ,idx+1+i)
#                print(last_idx, idx ,idx+1+i)

            last_idx, idx = idx, (n+2)*l+1

        # output
        centers = [newPoint(c.real, c.imag) for c in self.cs]
        radii = [r.real for r in self.rs]
        circles = manyCircles(centers, radii)
        return circles, centers, radii
# ---------- end python ----------
dam = DataDam(DataA=python.circles, BufferDelay=10000000, BufferMode=0)
pipe = Pipe(Curve=dam, Radius=Slider(1.1, range=0..24), Caps=0)
yz = YZPlane(Origin=Point(0, 0, 0))
mirror = Mirror(Geometry=pipe, Plane=yz)  # -> Geometry, Transform
